% Simulink data dictionary test.sldd

Emergency = Simulink.ServiceBus()
  read: buttonPressed = read(), Asynchronous=false, Arguments=Simulink.BusElement(Name="buttonPressed", DataType="double")
  pressed: pressed(buttonValue), Asynchronous=false, Arguments=Simulink.BusElement(Name="buttonValue", DataType="double")

x0dot = 0
code = Simulink.ConfigSet(StartTime="0", StopTime="1", Solver="FixedStepDiscrete", ProdHWDeviceType="Intel->x86-64 (Windows64)", SystemTargetFile="ert.tlc", TargetLang="C++")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
TsSensors = 0.0001
simulation = Simulink.ConfigSet(StartTime="0", StopTime="10", RelTol="1e-3", Solver="VariableStepAuto", ProdHWDeviceType="Intel->x86-64 (Windows64)", SystemTargetFile="grt.tlc", TargetLang="C")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
Q = [1 0; 0 0]
R = 0.001

State = Simulink.Bus()
  position: double, Unit="rad"
  velocity: double, Unit="rad/s"
  acceleration: double, Unit="rad/s^2"

x0 = 180
Kr = [36.90399 4.858635]

linsys = ss(
  a=[0 1; 14.7247 -0.3003003],
  b=[0; 3.003003],
  c=[1 0; 0 1],
  d=[0; 0],
  dx0=[0; 0],
  x0=[0; 0],
  u0=0,
  y0=[0; 0],
  Ts=0)

TsControl = 0.01